# Grasshopper definition Caslefield lifestyle.gh (Grasshopper 1.0.8)
# plug-ins: Human

# ---- group: Input
# SPATIAL BINNING IN GRASSHOPPER
geo = Geometry([<point referenced from the Rhino model> x332])
x = Panel("30")
y = Panel("20")

# ----
Z = UnitZ(Factor=1)

# ---- group: Inclusion
sqgrid = Square(Plane=PlaneXY(0, 0, 0), Size=1, ExtentX=x, ExtentY=y)  # -> flatten(Cells), Points
area = Area(Geometry=sqgrid.Cells)  # -> Area, Centroid
merge = Merge(Data1=geo, Data2=area.Centroid)
pt = Point(merge)
incurves = PointInCurves(Point=pt, Curves=sqgrid.Cells)  # -> Relationship, Index, Point

# ----
amp = Amplitude(Vector=Z, Amplitude=Slider(30, range=0..100))
Z_2 = UnitZ(Factor=1)
move = Move(Geometry=geo, Motion=amp)  # -> Geometry, Transform
Z_3 = UnitZ(Factor=1)
amp_2 = Amplitude(Vector=Z_2, Amplitude=Slider(30, range=0..100))
amp_3 = Amplitude(Vector=Z_3, Amplitude=Slider(30, range=0..100))
preview = CustomPreview(
    Geometry=sqgrid.Cells,
    Material={diffuse=RGB(221, 160, 221), emission=RGB(66, 48, 66), shine=0.5, specular=RGB(255, 255, 255), transparency=0})
move_2 = Move(Geometry=sqgrid.Cells, Motion=amp_2)  # -> Geometry, Transform
move_3 = Move(Geometry=geo, Motion=amp_3)  # -> Geometry, Transform
ln = Line(StartPoint=geo, EndPoint=move_3.Geometry)

# ---- group: Check one cell
equals = Equality(FirstNumber=incurves.Index, SecondNumber="12")  # -> Equality, Inequality
cull = CullPattern(List=pt, CullPattern=equals.Equality)
panel = Panel(cull)

# ---- group: Check all cells
multiplication = Multiplication(A=x, B=y)
series = Series(Start=0, Step=1, Count=multiplication)  # -> simplify(graft(Series))
equals_2 = Equality(FirstNumber=incurves.Index, SecondNumber=series)  # -> Equality, Inequality
cull_2 = CullPattern(List=pt, CullPattern=equals_2.Equality)
panel_2 = Panel(cull_2)

# ----
# How do you read the result?
# 
# The first line isn0 | 21
# and that means that Point 0 is in
# curve 21
# 
# Same is true for
# 1 | 21
# 
# And the third line is 2 | 12
# and that means that point 2
# is in curve 12.
panel_3 = Panel(incurves.Index)
tstat = TreeStatistics(Tree=cull_2)  # -> Paths, Length, Count

# ---- group: Surface Grid
# Add contrast by "streching" the numbers
bnd = Bounds(Numbers=flatten(tstat.Length))
dom = ConstructDomain(DomainStart="0", DomainEnd="10")
remap = RemapNumbers(Value=tstat.Length, Source=bnd, Target=dom)  # -> Mapped, Clipped
Z_4 = UnitZ(Factor=remap.Mapped)
move_4 = Move(Geometry=area.Centroid, Motion=Z_4)  # -> Geometry, Transform
srfgrid = SurfaceFromPoints(Points=move_4.Geometry, UCount=x, Interpolate=False)

# ----
Z_5 = UnitZ(Factor=1)
amp_4 = Amplitude(Vector=Z_5, Amplitude=Slider(30, range=0..100))

# ---- group: Graphics & Baking
contour = Contour(Shape=srfgrid, Point=Point(0, 0, 0), Direction=Vector(0, 0, 1), Distance=Slider(0.03, range=0..1))
eval = EvaluateCurve(Curve=contour, Parameter=0)  # -> Point, Tangent, Angle
pdecon = Deconstruct(Point=eval.Point)  # -> XComponent, YComponent, ZComponent
bnd_2 = Bounds(Numbers=flatten(pdecon.ZComponent))
dedomain = DeconstructDomain(Domain=bnd_2)  # -> Start, End
gradient = Gradient(
    LowerLimit=dedomain.Start,
    UpperLimit=dedomain.End,
    Parameter=flatten(pdecon.ZComponent),
    stops=[0: RGB(255, 192, 255), 0: RGB(0, 192, 0), 0: RGB(37, 240, 209), 0: RGB(156, 232, 48), 0: RGB(202, 214, 31), 0: RGB(126, 82, 243), 0: RGB(185, 72, 91), 0: RGB(148, 188, 37), 0: RGB(195, 60, 97), 0: RGB(0, 0, 255)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])
preview_2 = CustomPreview(Geometry=flatten(contour), Material=gradient)
createatts = CreateAttributes(LayerName="Contours", Color=gradient, enableFullPath=False)

# ----
move_5 = Move(Geometry=contour, Motion=amp_4)  # -> Geometry, Transform

# ---- group: Graphics & Baking (continued)
bake = BakeGeometry(Bake=Button(), Geometry=flatten(move_5.Geometry), Attributes=createatts, DeleteOldBakes=False, PreserveTrees=False)
