# Grasshopper definition Sentiment Map.gh (Grasshopper 1.0.8)
# plug-ins: Human, Heron

path = FilePath("C:\Users\Haowen\Desktop\Skill Module\castlefield_sentiment_data.csv")
file = ReadFile(File=path, PerLineParse=True)
panel = Panel(file)
cull_i = CullIndex(List=file, Indices="0", Wrap=True)
tab = Panel(",")
split = TextSplit(Text=cull_i, Separators=tab)
panel_2 = Panel(split)
item = ListItem(List=split, Index="3", Wrap=True)  # -> Item, Item1, Item2, Item3, Item4, Item5
panel_3 = Panel(item.Item1)
panel_4 = Panel(item.Item2)
flatten_tree = FlattenTree(Tree=item.Item1, Path="{0}")
flatten_tree_2 = FlattenTree(Tree=item.Item, Path="{0}")
decimal_degrees_to_xy = DecimalDegreesToXY(Latitude=flatten_tree_2, Longitude=flatten_tree)  # -> XyPoint, Transform
point = Point([<point referenced from the Rhino model> x3499])
construct_domain = ConstructDomain(DomainStart=Slider(0, range=0..100), DomainEnd=Slider(5, range=0..1000))
deconstruct = Deconstruct(Point=point)  # -> XComponent, YComponent, ZComponent
remap_numbers = RemapNumbers(Value=item.Item2, Source=Domain(0, 1), Target=construct_domain)  # -> flatten(Mapped), Clipped
pt = ConstructPoint(XCoordinate=deconstruct.XComponent, YCoordinate=deconstruct.YComponent, ZCoordinate=remap_numbers.Mapped)
pt_2 = ConstructPoint(XCoordinate=deconstruct.XComponent, YCoordinate=deconstruct.YComponent, ZCoordinate=0)
line = Line(StartPoint=pt, EndPoint=pt_2)
panel_6 = Panel(pt)
unit_z = UnitZ(Factor=1)
unit_z_2 = UnitZ(Factor=1)
amplitude = Amplitude(Vector=unit_z, Amplitude=Slider(20, range=0..100))
amplitude_2 = Amplitude(Vector=unit_z_2, Amplitude=Slider(20, range=0..100))
move = Move(Geometry=line, Motion=amplitude)  # -> Geometry, Transform
move_2 = Move(Geometry=pt, Motion=amplitude_2)  # -> Geometry, Transform

# ---- group: Input
geo = Geometry([<point referenced from the Rhino model> x5000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])
y = Panel("40")
x = Panel("60")

# ---- group: Inclusion
sqgrid = Square(Plane=PlaneXY(0, 0, 0), Size=1, ExtentX=x, ExtentY=y)  # -> flatten(Cells), Points
area = Area(Geometry=sqgrid.Cells)  # -> Area, Centroid
merge = Merge(Data1=geo, Data2=area.Centroid)
pt_3 = Point(merge)
incurves = PointInCurves(Point=pt_3, Curves=sqgrid.Cells)  # -> Relationship, Index, Point

# ----
panel_7 = Panel(merge)
custom_preview = CustomPreview(
    Geometry=sqgrid.Cells,
    Material={diffuse=RGB(221, 160, 221), emission=RGB(66, 48, 66), shine=0.5, specular=RGB(255, 255, 255), transparency=0})
panel_8 = Panel(area.Centroid)
deconstruct_2 = Deconstruct(Point=geo)  # -> XComponent, YComponent, ZComponent

# ---- group: Check all cells
multiplication = Multiplication(A=x, B=y)
series = Series(Start=0, Step=1, Count=multiplication)  # -> simplify(graft(Series))
equals = Equality(FirstNumber=incurves.Index, SecondNumber=series)  # -> Equality, Inequality
cull = CullPattern(List=pt_3, CullPattern=equals.Equality)
panel_9 = Panel(cull)

# ----
# SPATIAL BINNING IN GRASSHOPPER
# How do you read the result?
# 
# The first line isn0 | 21
# and that means that Point 0 is in
# curve 21
# 
# Same is true for
# 1 | 21
# 
# And the third line is 2 | 12
# and that means that point 2
# is in curve 12.
# Add contrast by "streching" the numbers
panel_10 = Panel(pt_3)
panel_11 = Panel(incurves.Index)
tstat = TreeStatistics(Tree=cull)  # -> Paths, Length, Count

# ---- group: Check one cell
equals_2 = Equality(FirstNumber=incurves.Index, SecondNumber="12")  # -> Equality, Inequality
cull_2 = CullPattern(List=pt_3, CullPattern=equals_2.Equality)

# ----
dispatch = Dispatch(List=deconstruct_2.ZComponent, DispatchPattern=equals.Equality)  # -> ListA, ListB
panel_12 = Panel(dispatch.ListA)
average = Average(Input=dispatch.ListA)
panel_13 = Panel(average)
panel_14 = Panel(tstat.Length)
replace_nulls = ReplaceNulls(Items=panel_13, Replacements=Slider(0, range=0..100))  # -> flatten(Items), Count
panel_15 = Panel(replace_nulls.Items)

# ---- group: Surface Grid
bnd = Bounds(Numbers=flatten(panel_15))
dom = ConstructDomain(DomainStart="0", DomainEnd="16")
remap = RemapNumbers(Value=panel_15, Source=bnd, Target=dom)  # -> Mapped, Clipped
Z = UnitZ(Factor=remap.Mapped)
move_3 = Move(Geometry=area.Centroid, Motion=Z)  # -> Geometry, Transform
srfgrid = SurfaceFromPoints(Points=move_3.Geometry, UCount=x, Interpolate=False)

# ----
panel_16 = Panel(Z)
unit_z_3 = UnitZ(Factor=1)
amplitude_3 = Amplitude(Vector=unit_z_3, Amplitude=Slider(30, range=0..100))

# ---- group: Graphics & Baking
contour = Contour(Shape=srfgrid, Point=Point(0, 0, 0), Direction=Vector(0, 0, 1), Distance=Slider(0.09, range=0..1))
eval = EvaluateCurve(Curve=contour, Parameter=0)  # -> Point, Tangent, Angle
pdecon = Deconstruct(Point=eval.Point)  # -> XComponent, YComponent, ZComponent
bnd_2 = Bounds(Numbers=flatten(pdecon.ZComponent))
dedomain = DeconstructDomain(Domain=bnd_2)  # -> Start, End
gradient = Gradient(
    LowerLimit=dedomain.Start,
    UpperLimit=dedomain.End,
    Parameter=flatten(pdecon.ZComponent),
    stops=[0: RGB(75, 107, 169), 0.00337: RGB(234, 126, 0), 0.495: RGB(254, 244, 84), 1: RGB(234, 38, 0), 1: RGB(173, 203, 249)])
preview = CustomPreview(Geometry=flatten(contour), Material=gradient)
createatts = CreateAttributes(LayerName="Contours", Color=gradient, enableFullPath=False)

# ----
move_4 = Move(Geometry=contour, Motion=amplitude_3)  # -> Geometry, Transform

# ---- group: Graphics & Baking (continued)
bake = BakeGeometry(Bake=Button(), Geometry=flatten(move_4.Geometry), Attributes=createatts, DeleteOldBakes=False, PreserveTrees=False)
